# Grasshopper definition generate_frames_and_extrusion_rates.ghx (Grasshopper 1.0.8)

number_slider = Slider(5, range=0..10)
crv = Curve(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)
topoly = CurveToPolyline(Curve=crv, ToleranceDistance=number_slider, ToleranceAngle=0, MinEdge=number_slider)  # -> Polyline, Segments
Z = UnitZ(Factor=Slider(12, range=0..100))
move = Move(Geometry=topoly.Polyline, Motion=Z)  # -> Geometry, Transform
merge = Merge(Data1=topoly.Polyline, Data2=move.Geometry)
explode = Explode(Curve=merge, Recursive=True)  # -> Segments, Vertices

# ----
# Extrusion 50 % to 100 % based on distance to surface for first layer, 100 % on next layer
number_slider_2 = Slider(1, range=0..1)
bang = ExplodeTree(Data=explode.Vertices)  # -> Branch0, Branch1
lng = ListLength(List=bang.Branch1)
repeat = RepeatData(Data=number_slider_2, Length=lng)
brep = Brep(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)
srf_cp = SurfaceClosestPoint(Point=bang.Branch0, Surface=brep)  # -> Point, UVPoint, Distance
dom = ConstructDomain(DomainStart=Slider(0.5, range=0..1), DomainEnd=1)
bnd = Bounds(Numbers=srf_cp.Distance)
remap = RemapNumbers(Value=srf_cp.Distance, Source=bnd, Target=dom)  # -> Mapped, Clipped
entwine = Entwine(Branch00=remap.Mapped, Branch01=repeat, FlattenInputs=True)

xy = XYPlane(Origin=explode.Vertices)
pflip = FlipPlane(Plane=xy, ReverseX=False, ReverseY=False, SwapAxes=True)
lng_2 = ListLength(List=pflip)
subtraction = Subtraction(A=lng_2, B="19")
division = Division(A="1", B=Slider(2, range=0..5))
repeat_2 = RepeatData(Data="1", Length=subtraction)
repeat_3 = RepeatData(Data=division, Length="19")
merge_2 = Merge(Data1=repeat_2, Data2=repeat_3)
# If you give no values to extrusion_factors
# you get 100 % flow everywhere.
python_3_script = Python3Script(planes=pflip)  # -> out, frames
# ---------- python_3_script: Python ----------
#! python3
# r: compas

from compas_rhino.conversions import plane_to_compas_frame

frames = plane_to_compas_frame(planes)
# ---------- end python_3_script ----------
file_path = FilePath("C:\Users\tetov\fab_data\frames_extrusion.json")
python_3_script_2 = Python3Script(frames=python_3_script.frames, extrusion_factors=entwine, filepath=file_path, save=Button())  # -> out, dumps; inputs frames: tree, extrusion_factors: tree of Double, filepath: String, save: Boolean
# ---------- python_3_script_2: Python ----------
#! python3
# r: compas

import Rhino
import Grasshopper

from compas_rhino.conversions import plane_to_compas_frame
from compas.data import json_dump, json_dumps
from compas_ghpython.sets import ghtree_to_list


class MyComponent(Grasshopper.Kernel.GH_ScriptInstance):
    def RunScript(self,
            frames: Grasshopper.DataTree[object],
            extrusion_factors: Grasshopper.DataTree[float],
            filepath: str,
            save: bool):
        frames = ghtree_to_list(frames)

        data = {"frames": frames, "extrusion_factors": None}

        if extrusion_factors.DataCount > 0:
            data["extrusion_factors"] = ghtree_to_list(extrusion_factors)

        if save:
            json_dump(data, filepath)
# ---------- end python_3_script_2 ----------
